# Grasshopper definition Cuboct_ReinforcedNode_Plate.gh (Grasshopper 0.9.76)

height = Slider(0.188, range=0..0.5)
angle = Number(0.7853981634)
cos = Cosine(Value=angle)
sin = Sine(Value=angle)
plate_height = Slider(6.17, range=0..10)

# ----
# Toggle Switch controls array
toggle = BooleanToggle(False)
y = Slider(10, range=1..20)
z = Slider(8, range=1..20)
x = Slider(10, range=1..20)

neg = Negative(Value=0.5)
neg_2 = Negative(Value=0.5)
geo = Geometry()
neg_3 = Negative(Value=plate_height)
incrament = Incrament(A=z)
Z = UnitZ(Factor=neg_3)
incrament_2 = Incrament(A=z)
mesh = MeshBrep(
    Brep=geo,
    Settings={GridMaxCount=0, GridMinCount=16, JaggedSeams=False, MaxEdgeLength=0, MinEdgeLength=0.0001, MinTolerance=0, Refine=True, RefineAngle=0, RelativeTolerance=0.65, SimplePlanes=True, Tolerance=0})
_2x = Double(A=plate_height)
smesh = SimpleMesh()
weld = WeldMesh(Angle=3.141592654)
msplit = MeshSplitPlane(Plane=PlaneXY(0, 0, 0))  # -> Above, Below
custom_mesh_settings = SettingsCustom(
    StitchSeams=True,
    SimplePlanes=False,
    Refine=True,
    MinCount=16,
    MaxCount=400,
    AspectRatio=20,
    MaxDistance=0,
    MaxAngle=20,
    MinEdge=0,
    MaxEdge=0)

# ----
# Relative Density
# Use file units
strut_width = Slider(0.6, range=-0.501..1)
pitch = Slider(11.55, range=0..20)

csc = CoSecant(Value=angle)
# Convert pitch to strut length (of frame)
multiplication = Multiplication(A=pitch, B=0.5)
multiplication_2 = Multiplication(A=multiplication, B=csc)

halve = Halve(A=strut_width)
multiplication_3 = Multiplication(A=cos, B=strut_width)
multiplication_4 = Multiplication(A=strut_width, B=sin)
neg_4 = Negative(Value=halve)
# L2/h3
addition = Addition(A=height, B=halve)
neg_5 = Negative(Value=addition)
# L3
addition_2 = Addition(A=multiplication_3, B=addition)
# Original height
addition_3 = Addition(A=multiplication_4, B=halve)
neg_6 = Negative(Value=addition_2)
# h2
addition_4 = Addition(A=addition_3, B=height)

sqrt = SquareRoot(Value=2)
multiplication_5 = Multiplication(A=multiplication_2, B=2)
midnodept = ConstructPoint(XCoordinate=expr("x/sqrt(2)", multiplication_2), YCoordinate=expr("x/sqrt(2)", multiplication_2), ZCoordinate=0)
midnodept_2 = ConstructPoint(XCoordinate=expr("-x/sqrt(2)", multiplication_2), YCoordinate=expr("-x/sqrt(2)", multiplication_2), ZCoordinate=0)
division = Division(A=multiplication_5, B=sqrt)
rec_2pt = Rectangle2Pt(Plane=PlaneXY(0, 0, 0), PointA=midnodept, PointB=midnodept_2, Radius=0)  # -> Rectangle, Length
boxrec = BoxRectangle(Rectangle=rec_2pt.Rectangle, Height=division)

pt = ConstructPoint(XCoordinate=addition_2, YCoordinate=halve, ZCoordinate=0)
pt_2 = ConstructPoint(XCoordinate=addition_2, YCoordinate=neg_4, ZCoordinate=0)
pt_3 = ConstructPoint(XCoordinate=neg_4, YCoordinate=neg_6, ZCoordinate=0)
pt_4 = ConstructPoint(XCoordinate=neg_6, YCoordinate=neg_4, ZCoordinate=0)
pt_5 = ConstructPoint(XCoordinate=halve, YCoordinate=neg_6, ZCoordinate=0)
pt_6 = ConstructPoint(XCoordinate=halve, YCoordinate=addition_2, ZCoordinate=0)
pt_7 = ConstructPoint(XCoordinate=neg_4, YCoordinate=addition_2, ZCoordinate=0)
pt_8 = ConstructPoint(XCoordinate=neg_6, YCoordinate=halve, ZCoordinate=0)

pt_9 = ConstructPoint(XCoordinate=addition, YCoordinate=neg_4, ZCoordinate=addition_4)
# Top
pt_10 = ConstructPoint(XCoordinate=addition, YCoordinate=halve, ZCoordinate=addition_4)
pt_11 = ConstructPoint(XCoordinate=neg_5, YCoordinate=halve, ZCoordinate=addition_4)
pt_12 = ConstructPoint(XCoordinate=neg_5, YCoordinate=neg_4, ZCoordinate=addition_4)
pt_13 = ConstructPoint(XCoordinate=halve, YCoordinate=neg_5, ZCoordinate=addition_4)
pt_14 = ConstructPoint(XCoordinate=neg_4, YCoordinate=addition, ZCoordinate=addition_4)
pt_15 = ConstructPoint(XCoordinate=halve, YCoordinate=addition, ZCoordinate=addition_4)
pt_16 = ConstructPoint(XCoordinate=neg_4, YCoordinate=neg_5, ZCoordinate=addition_4)

pt_17 = ConstructPoint(XCoordinate=addition_2, YCoordinate=halve, ZCoordinate=addition)
pt_18 = ConstructPoint(XCoordinate=addition_2, YCoordinate=neg_4, ZCoordinate=addition)
pt_19 = ConstructPoint(XCoordinate=neg_4, YCoordinate=neg_6, ZCoordinate=addition)
pt_20 = ConstructPoint(XCoordinate=neg_4, YCoordinate=addition_2, ZCoordinate=addition)
pt_21 = ConstructPoint(XCoordinate=neg_6, YCoordinate=neg_4, ZCoordinate=addition)
pt_22 = ConstructPoint(XCoordinate=halve, YCoordinate=neg_6, ZCoordinate=addition)
pt_23 = ConstructPoint(XCoordinate=neg_6, YCoordinate=halve, ZCoordinate=addition)
pt_24 = ConstructPoint(XCoordinate=halve, YCoordinate=addition_2, ZCoordinate=addition)

midnodept_3 = ConstructPoint(XCoordinate=expr("x/sqrt(2)", multiplication_2), YCoordinate=0, ZCoordinate=expr("x/sqrt(2)", multiplication_2))
topnode = ConstructPoint(XCoordinate=0, YCoordinate=0, ZCoordinate=expr("2*x/sqrt(2)", multiplication_2))
cubevector = VectorXYZ(XComponent=expr("-x", 1), YComponent=expr("x", 1), ZComponent=0)  # -> Vector, Length
panel = Panel("Frame Geometry")
ln = Line(StartPoint=midnodept_3, EndPoint=topnode)
line = LineSDL(Start=midnodept_3, Direction=cubevector.Vector, Length=multiplication_2)
ln_2 = Line(StartPoint=Point(0, 0, 0), EndPoint=midnodept_3)
arrpolar = PolarArray(Geometry=midnodept_3, Plane=PlaneXY(0, 0, 0), Count=4, Angle=6.283185307)  # -> Geometry, Transform
arrpolar_2 = PolarArray(Geometry=line, Plane=PlaneXY(0, 0, 0), Count=4, Angle=6.283185307)  # -> Geometry, Transform
arrpolar_3 = PolarArray(Geometry=ln, Plane=PlaneXY(0, 0, 0), Count=4, Angle=6.283185307)  # -> Geometry, Transform
arrpolar_4 = PolarArray(Geometry=ln_2, Plane=PlaneXY(0, 0, 0), Count=4, Angle=6.283185307)  # -> Geometry, Transform
item = ListItem(List=arrpolar.Geometry, Index=1, Wrap=True)
item_2 = ListItem(List=arrpolar.Geometry, Index=2, Wrap=True)
item_3 = ListItem(List=arrpolar.Geometry, Index=3, Wrap=True)
item_4 = ListItem(List=arrpolar.Geometry, Index=0, Wrap=True)
merge = Merge(Data1=arrpolar_4.Geometry, Data2=arrpolar_3.Geometry, Data3=arrpolar_2.Geometry)

octosurface = OctogonSurface(A=pt_15, B=pt_14, B_2=pt_11, B_4=pt_12, B_3=pt_16, B_5=pt_13, B_6=pt_9, B_7=pt_10)

srf4pt = _4PointSurface(CornerA=pt_15, CornerB=pt_24, CornerC=pt_17, CornerD=pt_10)
srf4pt_2 = _4PointSurface(CornerA=pt_14, CornerB=pt_11, CornerC=pt_23, CornerD=pt_20)
srf4pt_3 = _4PointSurface(CornerA=pt_12, CornerB=pt_16, CornerC=pt_19, CornerD=pt_21)
srf4pt_4 = _4PointSurface(CornerA=pt_13, CornerB=pt_9, CornerC=pt_18, CornerD=pt_22)

srf4pt_5 = _4PointSurface(CornerA=pt_24, CornerB=pt_6, CornerC=pt, CornerD=pt_17)
srf4pt_6 = _4PointSurface(CornerA=pt_20, CornerB=pt_7, CornerC=pt_8, CornerD=pt_23)
srf4pt_7 = _4PointSurface(CornerA=pt_21, CornerB=pt_19, CornerC=pt_3, CornerD=pt_4)
srf4pt_8 = _4PointSurface(CornerA=pt_22, CornerB=pt_18, CornerC=pt_2, CornerD=pt_5)

srf4pt_9 = _4PointSurface(CornerA=pt_24, CornerB=pt_20, CornerC=pt_7, CornerD=pt_6)
srf4pt_10 = _4PointSurface(CornerA=pt_23, CornerB=pt_21, CornerC=pt_4, CornerD=pt_8)
srf4pt_11 = _4PointSurface(CornerA=pt_19, CornerB=pt_22, CornerC=pt_5, CornerD=pt_3)
srf4pt_12 = _4PointSurface(CornerA=pt_18, CornerB=pt_17, CornerC=pt, CornerD=pt_2)

merge_2 = Merge(Data1=srf4pt_5, Data2=srf4pt_6, Data3=srf4pt_7, Data4=srf4pt_8)
merge_3 = Merge(Data1=srf4pt_9, Data2=srf4pt_10, Data3=srf4pt_11, Data4=srf4pt_12)
merge_4 = Merge(Data1=srf4pt, Data2=srf4pt_2, Data3=srf4pt_3, Data4=srf4pt_4)
# points at strut intersection
merge_5 = Merge(Data1=pt_10, Data2=pt_9, Data3=pt_17, Data4=pt_18)

mid_strut_nodept = ConstructPoint(XCoordinate=expr("0.5*x/sqrt(2)", multiplication_2), YCoordinate=0, ZCoordinate=expr("0.5*x/sqrt(2)", multiplication_2))
plfit = PlaneFit(Points=merge_5)  # -> Plane, Deviation
pt_25 = PointOriented(BasePlane=plfit.Plane, UComponent=0, VComponent=0, WComponent=0)
bottom_strut_vector = Vector2Pt(PointA=pt_25, PointB=mid_strut_nodept, Unitize=False)  # -> Vector, Length
geo_2 = Geometry(merge_5)
move = Move(Geometry=geo_2, Motion=bottom_strut_vector.Vector)  # -> Geometry, Transform

merge_6 = Merge(Data1=merge_2, Data2=merge_3, Data3=merge_4, Data4=octosurface)
octosurface_2 = OctogonSurface(A=pt_6, B=pt_7, B_2=pt_8, B_4=pt_4, B_3=pt_3, B_5=pt_5, B_6=pt_2, B_7=pt)
yz = YZPlane(Origin=item_2)
xz = XZPlane(Origin=item_3)
xz_2 = XZPlane(Origin=item)
plfit_2 = PlaneFit(Points=arrpolar.Geometry)  # -> Plane, Deviation
multiplication_6 = Multiplication(A=y, B=pitch)
multiplication_7 = Multiplication(A=x, B=pitch)
multiplication_8 = Multiplication(A=neg, B=pitch)
multiplication_9 = Multiplication(A=neg_2, B=pitch)
addition_5 = Addition(A=multiplication_6, B=multiplication_9)
addition_6 = Addition(A=multiplication_7, B=multiplication_8)
pt_26 = ConstructPoint(XCoordinate=0, YCoordinate=0, ZCoordinate=multiplication_9)
pt_27 = ConstructPoint(XCoordinate=multiplication_9, YCoordinate=multiplication_9, ZCoordinate=multiplication_9)
pt_28 = ConstructPoint(XCoordinate=addition_6, YCoordinate=addition_5, ZCoordinate=multiplication_9)
xy = XYPlane(Origin=pt_26)
rec_2pt_2 = Rectangle2Pt(Plane=xy, PointA=pt_27, PointB=pt_28, Radius=0)  # -> Rectangle, Length
multiplication_10 = Multiplication(A=incrament, B=pitch)
multiplication_11 = Multiplication(A=-1, B=pitch)
multiplication_12 = Multiplication(A=incrament_2, B=pitch)
addition_7 = Addition(A=multiplication_10, B=_2x)
addition_8 = Addition(A=multiplication_12, B=plate_height)
Z_2 = UnitZ(Factor=multiplication_11)
multiplication_13 = Multiplication(A=z, B=pitch)
multiplication_14 = Multiplication(A=-1, B=pitch)
Z_3 = UnitZ(Factor=multiplication_13)
Z_4 = UnitZ(Factor=multiplication_14)
multiplication_15 = Multiplication(A=z, B=pitch)
extr = Extrude(Base=rec_2pt_2.Rectangle, Direction=Z)
edges = BrepEdges(Brep=extr)  # -> Naked, Interior, NonManifold
item_5 = ListItem(List=edges.Naked, Index=2, Wrap=True)
item_6 = ListItem(List=edges.Naked, Index=0, Wrap=True)
item_7 = ListItem(List=edges.Naked, Index=4, Wrap=True)
item_8 = ListItem(List=edges.Naked, Index=3, Wrap=True)
Z_5 = UnitZ(Factor=multiplication_15)
edgesrf = EdgeSurface(CurveA=item_6, CurveB=item_5, CurveC=item_8, CurveD=item_7)
Z_6 = UnitZ(Factor=addition_8)
Z_7 = UnitZ(Factor=addition_7)
mesh_2 = MeshBrep(
    Brep=extr,
    Settings={GridMaxCount=0, GridMinCount=16, JaggedSeams=False, MaxEdgeLength=0, MinEdgeLength=0.0001, MinTolerance=0, Refine=True, RefineAngle=0, RelativeTolerance=0.65, SimplePlanes=True, Tolerance=0})
mesh_3 = MeshBrep(
    Brep=edgesrf,
    Settings={GridMaxCount=0, GridMinCount=16, JaggedSeams=False, MaxEdgeLength=0, MinEdgeLength=0.0001, MinTolerance=0, Refine=True, RefineAngle=0, RelativeTolerance=0.65, SimplePlanes=True, Tolerance=0})
move_2 = Move(Geometry=edgesrf, Motion=Z_7)  # -> Geometry, Transform
move_3 = Move(Geometry=extr, Motion=Z_6)  # -> Geometry, Transform
mesh_4 = MeshBrep(
    Brep=move_2.Geometry,
    Settings={GridMaxCount=0, GridMinCount=16, JaggedSeams=False, MaxEdgeLength=0, MinEdgeLength=0.0001, MinTolerance=0, Refine=True, RefineAngle=0, RelativeTolerance=0.65, SimplePlanes=True, Tolerance=0})
mesh_5 = MeshBrep(
    Brep=move_3.Geometry,
    Settings={GridMaxCount=0, GridMinCount=16, JaggedSeams=False, MaxEdgeLength=0, MinEdgeLength=0.0001, MinTolerance=0, Refine=True, RefineAngle=0, RelativeTolerance=0.65, SimplePlanes=True, Tolerance=0})
multiplication_16 = Multiplication(A=z, B=pitch)
multiplication_17 = Multiplication(A=-1, B=pitch)
multiplication_18 = Multiplication(A=z, B=pitch)
multiplication_19 = Multiplication(A=-1, B=pitch)
Z_8 = UnitZ(Factor=multiplication_16)
Z_9 = UnitZ(Factor=multiplication_17)
Z_10 = UnitZ(Factor=multiplication_18)
Z_11 = UnitZ(Factor=multiplication_19)
multiplication_20 = Multiplication(A=y, B=pitch)
multiplication_21 = Multiplication(A=y, B=pitch)
Y = UnitY(Factor=multiplication_20)
Y_2 = UnitY(Factor=multiplication_21)
multiplication_22 = Multiplication(A=x, B=pitch)
multiplication_23 = Multiplication(A=x, B=pitch)
X = UnitX(Factor=multiplication_22)
X_2 = UnitX(Factor=multiplication_23)

item_9 = ListItem(List=merge_5, Index=1, Wrap=True)
item_10 = ListItem(List=merge_5, Index=0, Wrap=True)
item_11 = ListItem(List=merge_5, Index=2, Wrap=True)
item_12 = ListItem(List=merge_5, Index=3, Wrap=True)
item_13 = ListItem(List=move.Geometry, Index=2, Wrap=True)
item_14 = ListItem(List=move.Geometry, Index=1, Wrap=True)
item_15 = ListItem(List=move.Geometry, Index=0, Wrap=True)
item_16 = ListItem(List=move.Geometry, Index=3, Wrap=True)
srf4pt_13 = _4PointSurface(CornerA=item_9, CornerB=item_14, CornerC=item_16, CornerD=item_12)
srf4pt_14 = _4PointSurface(CornerA=item_9, CornerB=item_10, CornerC=item_15, CornerD=item_14)
srf4pt_15 = _4PointSurface(CornerA=item_10, CornerB=item_15, CornerC=item_13, CornerD=item_11)
srf4pt_16 = _4PointSurface(CornerA=item_11, CornerB=item_13, CornerC=item_16, CornerD=item_12)
merge_7 = Merge(Data1=srf4pt_13, Data2=srf4pt_14, Data3=srf4pt_15, Data4=srf4pt_16)

fmerge = MergeFaces(Brep=merge_7)  # -> Breps, Before, After

arrpolar_5 = PolarArray(Geometry=fmerge.Breps, Plane=PlaneXY(0, 0, 0), Count=4, Angle=6.283185307)  # -> Geometry, Transform

merge_8 = Merge(Data1=merge_6, Data2=arrpolar_5.Geometry)
orient = Orient(Geometry=merge_8, Source=PlaneXY(0, 0, 0), Target=xz_2)  # -> Geometry, Transform
mirror = Mirror(Geometry=merge_8, Plane=plfit_2.Plane)  # -> Geometry, Transform
arrpolar_6 = PolarArray(Geometry=orient.Geometry, Plane=PlaneXY(0, 0, 0), Count=4, Angle=6.283185307)  # -> Geometry, Transform
merge_9 = Merge(Data1=merge_8, Data2=mirror.Geometry, Data3=arrpolar_6.Geometry)
flatten = FlattenTree(Tree=merge_9, Path="{0}")
join = BrepJoin(Breps=flatten)  # -> Breps, Closed

neg_7 = Negative(Value=pitch)
dom = ConstructDomain(DomainStart=expr("0.5*x", neg_7), DomainEnd=expr("0.5*x", pitch))
planesrf = PlaneSurface(Plane=plfit_2.Plane, XSize=dom, YSize=dom)
split = SplitBrep(Brep=join.Breps, Cutter=planesrf)
split_2 = SplitBrep(Brep=planesrf, Cutter=join.Breps)
item_17 = ListItem(List=split_2, Index=0, Wrap=True)
item_18 = ListItem(List=split_2, Index=1, Wrap=True)
item_19 = ListItem(List=split_2, Index=4, Wrap=True)
item_20 = ListItem(List=split_2, Index=2, Wrap=True)
item_21 = ListItem(List=split_2, Index=5, Wrap=True)
item_22 = ListItem(List=split_2, Index=3, Wrap=True)

# ----
# PlateSurface
merge_10 = Merge(Data1=item_18, Data2=item_20, Data3=item_22, Data4=item_19, Data5=item_21)

# ----
# BottomPlateInterface
item_23 = ListItem(List=split, Index=1, Wrap=True)

# ----
# TopPlateInterface
item_24 = ListItem(List=split, Index=0, Wrap=True)

bbox = BoundingBox(Content=join.Breps, Plane=PlaneXY(0, 0, 0))  # -> Box, Box_2
densityrel = RelativeDensity(C=join.Breps)  # -> R, R_2

# ----
# Initial Geometry Inputs
panel_2 = Panel(densityrel.R)

geo_3 = Geometry(join.Breps)
bbox_2 = BoundingBox(Content=join.Breps, Plane=PlaneXY(0, 0, 0))  # -> Box, Box_2
# Connect these two when you want to array the thing
dispatch = Dispatch(List=geo_3, DispatchPattern=toggle)  # -> ListA, ListB
flatten_2 = FlattenTree(Tree=merge_10, Path="{0}")
join_2 = BrepJoin(Breps=flatten_2)  # -> Breps, Closed
# Connect these two when you want to array the thing
mesh_6 = MeshBrep(
    Brep=geo_3,
    Settings={GridMaxCount=0, GridMinCount=16, JaggedSeams=False, MaxEdgeLength=0, MinEdgeLength=0.0001, MinTolerance=0, Refine=True, RefineAngle=0, RelativeTolerance=0.65, SimplePlanes=True, Tolerance=0})
arrbox = BoxArray(Cell=bbox.Box, XCount=x, YCount=y, ZCount=z)  # -> Geometry, Transform
flatten_3 = FlattenTree(Tree=arrbox.Geometry, Path="{0}")
geo_4 = Geometry(join_2.Breps)
mesh_7 = MeshBrep(
    Brep=merge_10,
    Settings={GridMaxCount=0, GridMinCount=16, JaggedSeams=False, MaxEdgeLength=0, MinEdgeLength=0.0001, MinTolerance=0, Refine=True, RefineAngle=0, RelativeTolerance=0.65, SimplePlanes=True, Tolerance=0})
join_3 = BrepJoin(Breps=flatten_3)  # -> Breps, Closed
cap = CapHoles(Brep=join_3.Breps)
arrbox_2 = BoxArray(Geometry=mesh_6, Cell=bbox.Box, XCount=x, YCount=y, ZCount=z)  # -> Geometry, Transform
move_4 = Move(Geometry=item_23, Motion=Z_2)  # -> Geometry, Transform
move_5 = Move(Geometry=mesh_7, Motion=Z_4)  # -> Geometry, Transform
move_6 = Move(Geometry=item_24, Motion=Z_3)  # -> Geometry, Transform
mesh_8 = MeshBrep(
    Brep=move_4.Geometry,
    Settings={GridMaxCount=0, GridMinCount=16, JaggedSeams=False, MaxEdgeLength=0, MinEdgeLength=0.0001, MinTolerance=0, Refine=True, RefineAngle=0, RelativeTolerance=0.65, SimplePlanes=True, Tolerance=0})
move_7 = Move(Geometry=geo_4, Motion=Z_5)  # -> Geometry, Transform

# ----
# <-----Bake this for array mesh
# <-----Bake this for array geometry
# <-----Bake this for single voxel
mesh_9 = MeshBrep(
    Brep=cap,
    Settings={GridMaxCount=0, GridMinCount=16, JaggedSeams=False, MaxEdgeLength=0, MinEdgeLength=0.0001, MinTolerance=0, Refine=True, RefineAngle=0, RelativeTolerance=0.65, SimplePlanes=True, Tolerance=0})
geo_5 = Geometry(cap)
geo_6 = Geometry(geo_3)

mesh_10 = MeshBrep(
    Brep=move_6.Geometry,
    Settings={GridMaxCount=0, GridMinCount=16, JaggedSeams=False, MaxEdgeLength=0, MinEdgeLength=0.0001, MinTolerance=0, Refine=True, RefineAngle=0, RelativeTolerance=0.65, SimplePlanes=True, Tolerance=0})
arrrec = RectangularArray(Geometry=mesh_8, Cell=bbox_2.Box, XCount=x, YCount=y)  # -> Geometry, Transform
arrrec_2 = RectangularArray(Geometry=move_5.Geometry, Cell=bbox_2.Box, XCount=x, YCount=y)  # -> Geometry, Transform
mesh_11 = MeshBrep(
    Brep=move_7.Geometry,
    Settings={GridMaxCount=0, GridMinCount=16, JaggedSeams=False, MaxEdgeLength=0, MinEdgeLength=0.0001, MinTolerance=0, Refine=True, RefineAngle=0, RelativeTolerance=0.65, SimplePlanes=True, Tolerance=0})
arrrec_3 = RectangularArray(Geometry=mesh_10, Cell=bbox_2.Box, XCount=x, YCount=y)  # -> Geometry, Transform
arrrec_4 = RectangularArray(Geometry=mesh_11, Cell=bbox_2.Box, XCount=x, YCount=y)  # -> Geometry, Transform

orient_2 = Orient(Geometry=octosurface_2, Source=PlaneXY(0, 0, 0), Target=yz)  # -> Geometry, Transform
orient_3 = Orient(Geometry=octosurface_2, Source=PlaneXY(0, 0, 0), Target=xz)  # -> Geometry, Transform
arrbox_3 = BoxArray(Geometry=mesh, Cell=bbox.Box, XCount=x, YCount=y, ZCount=1)  # -> Geometry, Transform
multiplication_24 = Multiplication(A=x, B=pitch)
multiplication_25 = Multiplication(A=z, B=pitch)
multiplication_26 = Multiplication(A=y, B=pitch)
Y_3 = UnitY(Factor=multiplication_26)
X_3 = UnitX(Factor=multiplication_24)
Z_12 = UnitZ(Factor=multiplication_25)
move_8 = Move(Geometry=arrbox_3.Geometry, Motion=Z_12)  # -> Geometry, Transform

mesh_12 = MeshBrep(
    Brep=orient_3.Geometry,
    Settings={GridMaxCount=0, GridMinCount=16, JaggedSeams=False, MaxEdgeLength=0, MinEdgeLength=0.0001, MinTolerance=0, Refine=True, RefineAngle=0, RelativeTolerance=0.65, SimplePlanes=True, Tolerance=0})
mesh_13 = MeshBrep(
    Brep=orient_2.Geometry,
    Settings={GridMaxCount=0, GridMinCount=16, JaggedSeams=False, MaxEdgeLength=0, MinEdgeLength=0.0001, MinTolerance=0, Refine=True, RefineAngle=0, RelativeTolerance=0.65, SimplePlanes=True, Tolerance=0})

arrbox_4 = BoxArray(Geometry=mesh_12, Cell=bbox.Box, XCount=x, YCount=1, ZCount=z)  # -> Geometry, Transform
arrbox_5 = BoxArray(Geometry=mesh_13, Cell=bbox.Box, XCount=1, YCount=y, ZCount=z)  # -> Geometry, Transform
move_9 = Move(Geometry=arrbox_4.Geometry, Motion=Y_3)  # -> Geometry, Transform
move_10 = Move(Geometry=arrbox_5.Geometry, Motion=X_3)  # -> Geometry, Transform

split_3 = SplitBrep(Brep=orient_3.Geometry, Cutter=planesrf)
split_4 = SplitBrep(Brep=orient_2.Geometry, Cutter=planesrf)
item_25 = ListItem(List=split_3, Index=1, Wrap=True)
item_26 = ListItem(List=split_3, Index=0, Wrap=True)
item_27 = ListItem(List=split_4, Index=1, Wrap=True)
item_28 = ListItem(List=split_4, Index=0, Wrap=True)
mesh_14 = MeshBrep(
    Brep=item_25,
    Settings={GridMaxCount=0, GridMinCount=16, JaggedSeams=False, MaxEdgeLength=0, MinEdgeLength=0.0001, MinTolerance=0, Refine=True, RefineAngle=0, RelativeTolerance=0.65, SimplePlanes=True, Tolerance=0})
mesh_15 = MeshBrep(
    Brep=item_27,
    Settings={GridMaxCount=0, GridMinCount=16, JaggedSeams=False, MaxEdgeLength=0, MinEdgeLength=0.0001, MinTolerance=0, Refine=True, RefineAngle=0, RelativeTolerance=0.65, SimplePlanes=True, Tolerance=0})
mesh_16 = MeshBrep(
    Brep=item_26,
    Settings={GridMaxCount=0, GridMinCount=16, JaggedSeams=False, MaxEdgeLength=0, MinEdgeLength=0.0001, MinTolerance=0, Refine=True, RefineAngle=0, RelativeTolerance=0.65, SimplePlanes=True, Tolerance=0})
mesh_17 = MeshBrep(
    Brep=item_28,
    Settings={GridMaxCount=0, GridMinCount=16, JaggedSeams=False, MaxEdgeLength=0, MinEdgeLength=0.0001, MinTolerance=0, Refine=True, RefineAngle=0, RelativeTolerance=0.65, SimplePlanes=True, Tolerance=0})
move_11 = Move(Geometry=mesh_14, Motion=Z_8)  # -> Geometry, Transform
move_12 = Move(Geometry=mesh_16, Motion=Z_9)  # -> Geometry, Transform
move_13 = Move(Geometry=mesh_15, Motion=Z_10)  # -> Geometry, Transform
move_14 = Move(Geometry=mesh_17, Motion=Z_11)  # -> Geometry, Transform
arrrec_5 = RectangularArray(Geometry=move_11.Geometry, Cell=bbox.Box, XCount=x, YCount=1)  # -> Geometry, Transform
arrrec_6 = RectangularArray(Geometry=move_12.Geometry, Cell=bbox.Box, XCount=x, YCount=1)  # -> Geometry, Transform
arrrec_7 = RectangularArray(Geometry=move_14.Geometry, Cell=bbox.Box, XCount=1, YCount=y)  # -> Geometry, Transform
arrrec_8 = RectangularArray(Geometry=move_13.Geometry, Cell=bbox.Box, XCount=1, YCount=y)  # -> Geometry, Transform
move_15 = Move(Geometry=arrrec_5.Geometry, Motion=Y)  # -> Geometry, Transform
move_16 = Move(Geometry=arrrec_6.Geometry, Motion=Y_2)  # -> Geometry, Transform
move_17 = Move(Geometry=arrrec_7.Geometry, Motion=X)  # -> Geometry, Transform
move_18 = Move(Geometry=arrrec_8.Geometry, Motion=X_2)  # -> Geometry, Transform
merge_11 = Merge(
    Data1=arrbox_2.Geometry,
    Data2=arrbox_4.Geometry,
    Data3=move_9.Geometry,
    Data4=arrbox_5.Geometry,
    Data5=move_10.Geometry,
    Data6=arrbox_3.Geometry,
    Data7=move_8.Geometry,
    Data8=arrrec_6.Geometry,
    Data9=move_16.Geometry,
    Data10=arrrec_5.Geometry,
    Data11=move_15.Geometry,
    Data12=arrrec_7.Geometry,
    Data13=move_17.Geometry,
    Data14=arrrec_8.Geometry,
    Data15=move_18.Geometry,
    Data16=arrrec_4.Geometry,
    Data17=arrrec.Geometry,
    Data18=mesh_5,
    Data19=mesh_4,
    Data20=mesh_2,
    Data21=mesh_3,
    Data22=arrrec_3.Geometry,
    Data23=arrrec_2.Geometry)
flatten_4 = FlattenTree(Tree=merge_11, Path="{0}")
mjoin = MeshJoin(Meshes=flatten_4)
weld_2 = WeldMesh(Mesh=mjoin, Angle=3.141592654)

# ==== cluster Halve
A = ClusterInput()
division = Division(A=A, B=2)
R = ClusterOutput(division)

# ==== cluster OctogonSurface
A = ClusterInput()
B = ClusterInput()
B_2 = ClusterInput()
B_3 = ClusterInput()
B_4 = ClusterInput()
B_5 = ClusterInput()
B_6 = ClusterInput()
B_7 = ClusterInput()
ln = Line(StartPoint=A, EndPoint=B)
ln_2 = Line(StartPoint=B, EndPoint=B_2)
ln_3 = Line(StartPoint=B_2, EndPoint=B_4)
ln_4 = Line(StartPoint=B_4, EndPoint=B_3)
ln_5 = Line(StartPoint=B_3, EndPoint=B_5)
ln_6 = Line(StartPoint=B_5, EndPoint=B_6)
ln_7 = Line(StartPoint=B_6, EndPoint=B_7)
ln_8 = Line(StartPoint=B_7, EndPoint=A)
merge = Merge(Data1=ln, Data2=ln_2, Data3=ln_3, Data4=ln_4, Data5=ln_5, Data6=ln_6, Data7=ln_7, Data8=ln_8)
join = JoinCurves(Curves=merge, Preserve=False)
boundary = BoundarySurfaces(Edges=join)
S = ClusterOutput(boundary)

# ==== cluster RelativeDensity
C = ClusterInput()

cap = CapHoles(Brep=C)
bbox = BoundingBox(Content=C, Plane=PlaneXY(0, 0, 0))  # -> Box, Box_2
volume = Volume(Geometry=cap)  # -> Volume, Centroid
volume_2 = Volume(Geometry=bbox.Box)  # -> Volume, Centroid
division = Division(A=volume.Volume, B=volume_2.Volume)

R = ClusterOutput(division)
R_2 = ClusterOutput(division)

# ==== cluster Incrament
A = ClusterInput()
addition = Addition(A=A, B=1)
R = ClusterOutput(addition)

# ==== cluster Double
A = ClusterInput()
num = Number(2)
multiplication = Multiplication(A=A, B=num)
R = ClusterOutput(multiplication)
