# Grasshopper definition Cuboct_ReinforcedNode_Plate_clean.gh (Grasshopper 0.9.76)

# ----
# Node Chamfer Factor
# (Obsolete)
chamfer_factor = Slider(3, range=1.001..5)
height = Slider(0.05, range=0..0.5)

# ----
# Remember plating adds top and bottom voxel half planes
hole_diameter_tension = Slider(6.756, range=0..10)
plate = BooleanToggle(False)
tension_specimen = BooleanToggle(True)
plate_height = Slider(12, range=-10.001..30)

# ----
# Inputs
# Remember: Use file units!
# Use BREP geometry? Not Recommended
output_brep_no_plate = BooleanToggle(False)
# Array Controls
x = Slider(10, range=1..20)
y = Slider(10, range=1..20)
z = Slider(10, range=1..20)

# ----
# Voxel Geometry Inputs
strut_width = Slider(0.1, range=-0.501..1)
pitch = Slider(3, range=0.5..30)

division = Division(A=strut_width, B=chamfer_factor)
cuboctvox = CubotVoxelGenerator(strut_width=strut_width, lattice_pitch=pitch, height=division)  # -> ocotohedral_cap_surface, nodegeometry, voxelgeometry
panel = Panel(division)
arraycapplate = MeshArrayAndCapAndPlate(
    voxelgeometry=cuboctvox.voxelgeometry,
    capgeometry=cuboctvox.ocotohedral_cap_surface,
    latticepitch=pitch,
    X=x,
    y=y,
    z=z,
    platebinary=plate,
    plateheight=plate_height,
    holediameter=hole_diameter_tension,
    tensionspecimen=tension_specimen)

# ----
# This code provides the wire-frame cuboct geometry of a single voxel if desired.
# Convert pitch to strut length (of frame)
angle = Number(0.7853981634)
csc = CoSecant(Value=angle)
multiplication = Multiplication(A=pitch, B=0.5)
multiplication_2 = Multiplication(A=multiplication, B=csc)

densityrel = RelativeDensity(C=cuboctvox.voxelgeometry)  # -> relativedensity, geometryvolume

# ----
# Relative Density (net)
panel_2 = Panel(densityrel.relativedensity)

# ----
# Diagnostics for understanding node reinforcement from Chamfer Factor
mincuboct = MinimumCuboct(strutwidth=strut_width, pitch=pitch)  # -> minimumnodegeometry, minimumvoxel
densityrel_2 = RelativeDensity(C=cuboctvox.nodegeometry)  # -> relativedensity, geometryvolume
join = BrepJoin(Breps=mincuboct.minimumnodegeometry)  # -> Breps, Closed
geo = Geometry(mincuboct.minimumvoxel)
capex = CapHolesEx(Brep=join.Breps)  # -> Brep, Caps, Solid
cap = CapHoles(Brep=geo)
item = ListItem(List=capex.Brep, Index=0, Wrap=True)
volume = Volume(Geometry=cap)  # -> Volume, Centroid
volume_2 = Volume(Geometry=item)  # -> Volume, Centroid
division_2 = Division(A=densityrel_2.geometryvolume, B=densityrel.geometryvolume)
division_3 = Division(A=volume.Volume, B=volume_2.Volume)
division_4 = Division(A=densityrel_2.geometryvolume, B=volume_2.Volume)
division_5 = Division(A=densityrel.geometryvolume, B=volume.Volume)
_1 = Integer(1)
_1_2 = Integer(1)
multiplication_3 = Multiplication(A=division_2, B=division_3)
subtraction = Subtraction(A=division_4, B=_1)
_1_3 = Integer(1)
subtraction_2 = Subtraction(A=division_5, B=_1_2)
subtraction_3 = Subtraction(A=multiplication_3, B=_1_3)

flatten = FlattenTree(Tree=arraycapplate, Path="{0}")
mjoin = MeshJoin(Meshes=flatten)
dispatch = Dispatch(List=cuboctvox.voxelgeometry, DispatchPattern=output_brep_no_plate)  # -> ListA, ListB
bbox = BoundingBox(Content=cuboctvox.voxelgeometry, Plane=PlaneXY(0, 0, 0))  # -> Box, Box_2

sqrt = SquareRoot(Value=2)
multiplication_4 = Multiplication(A=multiplication_2, B=2)
midnodept = ConstructPoint(XCoordinate=expr("x/sqrt(2)", multiplication_2), YCoordinate=expr("x/sqrt(2)", multiplication_2), ZCoordinate=0)
midnodept_2 = ConstructPoint(XCoordinate=expr("-x/sqrt(2)", multiplication_2), YCoordinate=expr("-x/sqrt(2)", multiplication_2), ZCoordinate=0)
division_6 = Division(A=multiplication_4, B=sqrt)
rec_2pt = Rectangle2Pt(Plane=PlaneXY(0, 0, 0), PointA=midnodept, PointB=midnodept_2, Radius=0)  # -> Rectangle, Length
boxrec = BoxRectangle(Rectangle=rec_2pt.Rectangle, Height=division_6)

midnodept_3 = ConstructPoint(XCoordinate=expr("x/sqrt(2)", multiplication_2), YCoordinate=0, ZCoordinate=expr("x/sqrt(2)", multiplication_2))
panel_3 = Panel("Frame Geometry")
topnode = ConstructPoint(XCoordinate=0, YCoordinate=0, ZCoordinate=expr("2*x/sqrt(2)", multiplication_2))
cubevector = VectorXYZ(XComponent=expr("-x", 1), YComponent=expr("x", 1), ZComponent=0)  # -> Vector, Length
arrpolar = PolarArray(Geometry=midnodept_3, Plane=PlaneXY(0, 0, 0), Count=4, Angle=6.283185307)  # -> Geometry, Transform
ln = Line(StartPoint=midnodept_3, EndPoint=topnode)
line = LineSDL(Start=midnodept_3, Direction=cubevector.Vector, Length=multiplication_2)
ln_2 = Line(StartPoint=Point(0, 0, 0), EndPoint=midnodept_3)
arrpolar_2 = PolarArray(Geometry=line, Plane=PlaneXY(0, 0, 0), Count=4, Angle=6.283185307)  # -> Geometry, Transform
arrpolar_3 = PolarArray(Geometry=ln, Plane=PlaneXY(0, 0, 0), Count=4, Angle=6.283185307)  # -> Geometry, Transform
item_2 = ListItem(List=arrpolar.Geometry, Index=1, Wrap=True)
item_3 = ListItem(List=arrpolar.Geometry, Index=2, Wrap=True)
item_4 = ListItem(List=arrpolar.Geometry, Index=3, Wrap=True)
item_5 = ListItem(List=arrpolar.Geometry, Index=0, Wrap=True)
arrpolar_4 = PolarArray(Geometry=ln_2, Plane=PlaneXY(0, 0, 0), Count=4, Angle=6.283185307)  # -> Geometry, Transform
merge = Merge(Data1=arrpolar_4.Geometry, Data2=arrpolar_3.Geometry, Data3=arrpolar_2.Geometry)

arrbox = BoxArray(Geometry=dispatch.ListA, Cell=bbox.Box, XCount=x, YCount=y, ZCount=z)  # -> Geometry, Transform
flatten_2 = FlattenTree(Tree=arrbox.Geometry, Path="{0}")
join_2 = BrepJoin(Breps=flatten_2)  # -> Breps, Closed
cap_2 = CapHoles(Brep=join_2.Breps)

# ----
# <-----Bake this for Mesh Array Geometry
weld = WeldMesh(Mesh=mjoin, Angle=3.141592654)

# ----
# Outputs
# <-----Bake this for BREP array geometry
# <-----Bake this for single voxel BREP geometry
geo_2 = Geometry(cap_2)
geo_3 = Geometry(cuboctvox.voxelgeometry)

# ----
# % increase of voxel mass
panel_4 = Panel(subtraction_2)

# ----
# % increase of node mass
panel_5 = Panel(subtraction)

# ----
# % increase of node mass fraction
panel_6 = Panel(subtraction_3)

# ==== cluster CubotVoxelGenerator
angle = Number(0.7853981634)
height = ClusterInput()  # Reinforcement parameter
strut_width = ClusterInput()
lattice_pitch = ClusterInput()  # Pitch of lattice. Make sure to use file units

csc = CoSecant(Value=angle)
# Convert pitch to strut length (of frame)
multiplication = Multiplication(A=lattice_pitch, B=0.5)
multiplication_2 = Multiplication(A=multiplication, B=csc)

halve = Halve(A=strut_width)
cos = Cosine(Value=angle)
sin = Sine(Value=angle)
multiplication_3 = Multiplication(A=cos, B=strut_width)
multiplication_4 = Multiplication(A=strut_width, B=sin)
neg = Negative(Value=halve)
# L2/h3
addition = Addition(A=height, B=halve)
neg_2 = Negative(Value=addition)
# L3
addition_2 = Addition(A=multiplication_3, B=addition)
# Original height
addition_3 = Addition(A=multiplication_4, B=halve)
neg_3 = Negative(Value=addition_2)
# h2
addition_4 = Addition(A=addition_3, B=height)

pt = ConstructPoint(XCoordinate=addition_2, YCoordinate=halve, ZCoordinate=0)
pt_2 = ConstructPoint(XCoordinate=addition_2, YCoordinate=neg, ZCoordinate=0)
pt_3 = ConstructPoint(XCoordinate=neg, YCoordinate=neg_3, ZCoordinate=0)
pt_4 = ConstructPoint(XCoordinate=neg_3, YCoordinate=neg, ZCoordinate=0)
pt_5 = ConstructPoint(XCoordinate=halve, YCoordinate=neg_3, ZCoordinate=0)
pt_6 = ConstructPoint(XCoordinate=halve, YCoordinate=addition_2, ZCoordinate=0)
pt_7 = ConstructPoint(XCoordinate=neg, YCoordinate=addition_2, ZCoordinate=0)
pt_8 = ConstructPoint(XCoordinate=neg_3, YCoordinate=halve, ZCoordinate=0)

pt_9 = ConstructPoint(XCoordinate=addition, YCoordinate=neg, ZCoordinate=addition_4)
# Top
pt_10 = ConstructPoint(XCoordinate=addition, YCoordinate=halve, ZCoordinate=addition_4)
pt_11 = ConstructPoint(XCoordinate=neg_2, YCoordinate=halve, ZCoordinate=addition_4)
pt_12 = ConstructPoint(XCoordinate=neg_2, YCoordinate=neg, ZCoordinate=addition_4)
pt_13 = ConstructPoint(XCoordinate=halve, YCoordinate=neg_2, ZCoordinate=addition_4)
pt_14 = ConstructPoint(XCoordinate=neg, YCoordinate=addition, ZCoordinate=addition_4)
pt_15 = ConstructPoint(XCoordinate=halve, YCoordinate=addition, ZCoordinate=addition_4)
pt_16 = ConstructPoint(XCoordinate=neg, YCoordinate=neg_2, ZCoordinate=addition_4)

pt_17 = ConstructPoint(XCoordinate=addition_2, YCoordinate=halve, ZCoordinate=addition)
pt_18 = ConstructPoint(XCoordinate=addition_2, YCoordinate=neg, ZCoordinate=addition)
pt_19 = ConstructPoint(XCoordinate=neg, YCoordinate=neg_3, ZCoordinate=addition)
pt_20 = ConstructPoint(XCoordinate=neg, YCoordinate=addition_2, ZCoordinate=addition)
pt_21 = ConstructPoint(XCoordinate=neg_3, YCoordinate=neg, ZCoordinate=addition)
pt_22 = ConstructPoint(XCoordinate=halve, YCoordinate=neg_3, ZCoordinate=addition)
pt_23 = ConstructPoint(XCoordinate=neg_3, YCoordinate=halve, ZCoordinate=addition)
pt_24 = ConstructPoint(XCoordinate=halve, YCoordinate=addition_2, ZCoordinate=addition)

midnodept = ConstructPoint(XCoordinate=expr("x/sqrt(2)", multiplication_2), YCoordinate=0, ZCoordinate=expr("x/sqrt(2)", multiplication_2))
panel = Panel("Frame Geometry")
arrpolar = PolarArray(Geometry=midnodept, Plane=PlaneXY(0, 0, 0), Count=4, Angle=6.283185307)  # -> Geometry, Transform
item = ListItem(List=arrpolar.Geometry, Index=1, Wrap=True)
item_2 = ListItem(List=arrpolar.Geometry, Index=2, Wrap=True)
item_3 = ListItem(List=arrpolar.Geometry, Index=3, Wrap=True)
item_4 = ListItem(List=arrpolar.Geometry, Index=0, Wrap=True)

octosurface = OctogonSurface(A=pt_15, B=pt_14, B_2=pt_11, B_4=pt_12, B_3=pt_16, B_5=pt_13, B_6=pt_9, B_7=pt_10)

srf4pt = _4PointSurface(CornerA=pt_15, CornerB=pt_24, CornerC=pt_17, CornerD=pt_10)
srf4pt_2 = _4PointSurface(CornerA=pt_14, CornerB=pt_11, CornerC=pt_23, CornerD=pt_20)
srf4pt_3 = _4PointSurface(CornerA=pt_12, CornerB=pt_16, CornerC=pt_19, CornerD=pt_21)
srf4pt_4 = _4PointSurface(CornerA=pt_13, CornerB=pt_9, CornerC=pt_18, CornerD=pt_22)

srf4pt_5 = _4PointSurface(CornerA=pt_24, CornerB=pt_6, CornerC=pt, CornerD=pt_17)
srf4pt_6 = _4PointSurface(CornerA=pt_20, CornerB=pt_7, CornerC=pt_8, CornerD=pt_23)
srf4pt_7 = _4PointSurface(CornerA=pt_21, CornerB=pt_19, CornerC=pt_3, CornerD=pt_4)
srf4pt_8 = _4PointSurface(CornerA=pt_22, CornerB=pt_18, CornerC=pt_2, CornerD=pt_5)

srf4pt_9 = _4PointSurface(CornerA=pt_24, CornerB=pt_20, CornerC=pt_7, CornerD=pt_6)
srf4pt_10 = _4PointSurface(CornerA=pt_23, CornerB=pt_21, CornerC=pt_4, CornerD=pt_8)
srf4pt_11 = _4PointSurface(CornerA=pt_19, CornerB=pt_22, CornerC=pt_5, CornerD=pt_3)
srf4pt_12 = _4PointSurface(CornerA=pt_18, CornerB=pt_17, CornerC=pt, CornerD=pt_2)

merge = Merge(Data1=srf4pt_5, Data2=srf4pt_6, Data3=srf4pt_7, Data4=srf4pt_8)
merge_2 = Merge(Data1=srf4pt_9, Data2=srf4pt_10, Data3=srf4pt_11, Data4=srf4pt_12)
merge_3 = Merge(Data1=srf4pt, Data2=srf4pt_2, Data3=srf4pt_3, Data4=srf4pt_4)
# points at strut intersection
merge_4 = Merge(Data1=pt_10, Data2=pt_9, Data3=pt_17, Data4=pt_18)

mid_strut_nodept = ConstructPoint(XCoordinate=expr("0.5*x/sqrt(2)", multiplication_2), YCoordinate=0, ZCoordinate=expr("0.5*x/sqrt(2)", multiplication_2))
plfit = PlaneFit(Points=merge_4)  # -> Plane, Deviation
pt_25 = PointOriented(BasePlane=plfit.Plane, UComponent=0, VComponent=0, WComponent=0)
bottom_strut_vector = Vector2Pt(PointA=pt_25, PointB=mid_strut_nodept, Unitize=False)  # -> Vector, Length
geo = Geometry(merge_4)
move = Move(Geometry=geo, Motion=bottom_strut_vector.Vector)  # -> Geometry, Transform

merge_5 = Merge(Data1=merge, Data2=merge_2, Data3=merge_3, Data4=octosurface)
octosurface_2 = OctogonSurface(A=pt_6, B=pt_7, B_2=pt_8, B_4=pt_4, B_3=pt_3, B_5=pt_5, B_6=pt_2, B_7=pt)
flatten = FlattenTree(Tree=merge_5, Path="{0}")
ocotohedral_cap_surface = ClusterOutput(octosurface_2)
join = BrepJoin(Breps=flatten)  # -> Breps, Closed
nodegeometry = ClusterOutput(join.Breps)
xz = XZPlane(Origin=item)
plfit_2 = PlaneFit(Points=arrpolar.Geometry)  # -> Plane, Deviation

item_5 = ListItem(List=merge_4, Index=1, Wrap=True)
item_6 = ListItem(List=merge_4, Index=0, Wrap=True)
item_7 = ListItem(List=merge_4, Index=2, Wrap=True)
item_8 = ListItem(List=merge_4, Index=3, Wrap=True)
item_9 = ListItem(List=move.Geometry, Index=2, Wrap=True)
item_10 = ListItem(List=move.Geometry, Index=1, Wrap=True)
item_11 = ListItem(List=move.Geometry, Index=0, Wrap=True)
item_12 = ListItem(List=move.Geometry, Index=3, Wrap=True)
srf4pt_13 = _4PointSurface(CornerA=item_5, CornerB=item_10, CornerC=item_12, CornerD=item_8)
srf4pt_14 = _4PointSurface(CornerA=item_5, CornerB=item_6, CornerC=item_11, CornerD=item_10)
srf4pt_15 = _4PointSurface(CornerA=item_6, CornerB=item_11, CornerC=item_9, CornerD=item_7)
srf4pt_16 = _4PointSurface(CornerA=item_7, CornerB=item_9, CornerC=item_12, CornerD=item_8)
merge_6 = Merge(Data1=srf4pt_13, Data2=srf4pt_14, Data3=srf4pt_15, Data4=srf4pt_16)

fmerge = MergeFaces(Brep=merge_6)  # -> Breps, Before, After

arrpolar_2 = PolarArray(Geometry=fmerge.Breps, Plane=PlaneXY(0, 0, 0), Count=4, Angle=6.283185307)  # -> Geometry, Transform

merge_7 = Merge(Data1=merge_5, Data2=arrpolar_2.Geometry)
orient = Orient(Geometry=merge_7, Source=PlaneXY(0, 0, 0), Target=xz)  # -> Geometry, Transform
mirror = Mirror(Geometry=merge_7, Plane=plfit_2.Plane)  # -> Geometry, Transform
arrpolar_3 = PolarArray(Geometry=orient.Geometry, Plane=PlaneXY(0, 0, 0), Count=4, Angle=6.283185307)  # -> Geometry, Transform
merge_8 = Merge(Data1=merge_7, Data2=mirror.Geometry, Data3=arrpolar_3.Geometry)
flatten_2 = FlattenTree(Tree=merge_8, Path="{0}")
join_2 = BrepJoin(Breps=flatten_2)  # -> Breps, Closed
voxelgeometry = ClusterOutput(join_2.Breps)

# ==== cluster RelativeDensity
C = ClusterInput()

cap = CapHoles(Brep=C)
bbox = BoundingBox(Content=C, Plane=PlaneXY(0, 0, 0))  # -> Box, Box_2
volume = Volume(Geometry=cap)  # -> Volume, Centroid
volume_2 = Volume(Geometry=bbox.Box)  # -> Volume, Centroid
division = Division(A=volume.Volume, B=volume_2.Volume)

geometryvolume = ClusterOutput(volume.Volume)
relativedensity = ClusterOutput(division)

# ==== cluster MeshArrayAndCapAndPlate

# ----
# Convert pitch to strut length (of frame)
angle = Number(0.7853981634)

holediameter = ClusterInput()
tensionspecimen = ClusterInput()  # Boolean
platewidth = ClusterInput()
voxelgeometry = ClusterInput()
capgeometry = ClusterInput()
platebinary = ClusterInput()
platelength = ClusterInput()
plateheight = ClusterInput()
z = ClusterInput()
latticepitch = ClusterInput()
y = ClusterInput()
X = ClusterInput()

csc = CoSecant(Value=angle)
multiplication = Multiplication(A=latticepitch, B=0.5)
multiplication_2 = Multiplication(A=multiplication, B=csc)

midnodept = ConstructPoint(XCoordinate=expr("x/sqrt(2)", multiplication_2), YCoordinate=0, ZCoordinate=expr("x/sqrt(2)", multiplication_2))
panel = Panel("Frame Geometry")
arrpolar = PolarArray(Geometry=midnodept, Plane=PlaneXY(0, 0, 0), Count=4, Angle=6.283185307)  # -> Geometry, Transform
item = ListItem(List=arrpolar.Geometry, Index=1, Wrap=True)
item_2 = ListItem(List=arrpolar.Geometry, Index=2, Wrap=True)
item_3 = ListItem(List=arrpolar.Geometry, Index=3, Wrap=True)
item_4 = ListItem(List=arrpolar.Geometry, Index=0, Wrap=True)

merge = Merge(Data1=voxelgeometry, Data2=capgeometry)
flatten = FlattenTree(Tree=merge, Path="{0}")
dispatch = Dispatch(List=latticepitch, DispatchPattern=platebinary)  # -> ListA, ListB
# Cap top? (for no plate)
dispatch_2 = Dispatch(List=voxelgeometry, DispatchPattern=platebinary)  # -> ListA, ListB
dispatch_3 = Dispatch(List=flatten, DispatchPattern=platebinary)  # -> ListA, ListB
item_5 = ListItem(List=dispatch_3.ListA, Index=0, Wrap=True)
item_6 = ListItem(List=dispatch_3.ListB, Index=1, Wrap=True)
yz = YZPlane(Origin=item_2)
plfit = PlaneFit(Points=arrpolar.Geometry)  # -> Plane, Deviation
xz = XZPlane(Origin=item)
xz_2 = XZPlane(Origin=item_3)

neg = Negative(Value=latticepitch)
dom = ConstructDomain(DomainStart=expr("0.5*x", neg), DomainEnd=expr("0.5*x", latticepitch))
planesrf = PlaneSurface(Plane=plfit.Plane, XSize=dom, YSize=dom)
split = SplitBrep(Brep=item_5, Cutter=planesrf)
split_2 = SplitBrep(Brep=planesrf, Cutter=item_5)
item_7 = ListItem(List=split_2, Index=0, Wrap=True)
item_8 = ListItem(List=split_2, Index=1, Wrap=True)
item_9 = ListItem(List=split_2, Index=4, Wrap=True)
item_10 = ListItem(List=split_2, Index=2, Wrap=True)
item_11 = ListItem(List=split_2, Index=5, Wrap=True)
item_12 = ListItem(List=split_2, Index=3, Wrap=True)

bbox = BoundingBox(Content=voxelgeometry, Plane=PlaneXY(0, 0, 0))  # -> Box, Box_2
_1_4_20_clearance_diameter_in_mm = Number(holediameter)
extra_width_on_plate_edge_outside_hole = Number(10)

# ----
# PlateSurface
merge_2 = Merge(Data1=item_8, Data2=item_10, Data3=item_12, Data4=item_9, Data5=item_11)

# ----
# BottomPlateInterface
item_13 = ListItem(List=split, Index=1, Wrap=True)

# ----
# TopPlateInterface
item_14 = ListItem(List=split, Index=0, Wrap=True)

bbox_2 = BoundingBox(Content=item_5, Plane=PlaneXY(0, 0, 0))  # -> Box, Box_2

orient = Orient(Geometry=capgeometry, Source=PlaneXY(0, 0, 0), Target=xz_2)  # -> Geometry, Transform
geo = Geometry(item_6)
orient_2 = Orient(Geometry=capgeometry, Source=PlaneXY(0, 0, 0), Target=yz)  # -> Geometry, Transform
mesh = MeshBrep(
    Brep=orient.Geometry,
    Settings={GridMaxCount=0, GridMinCount=16, JaggedSeams=False, MaxEdgeLength=0, MinEdgeLength=0.0001, MinTolerance=0, Refine=True, RefineAngle=0, RelativeTolerance=0.65, SimplePlanes=True, Tolerance=0})
mesh_2 = MeshBrep(
    Brep=orient_2.Geometry,
    Settings={GridMaxCount=0, GridMinCount=16, JaggedSeams=False, MaxEdgeLength=0, MinEdgeLength=0.0001, MinTolerance=0, Refine=True, RefineAngle=0, RelativeTolerance=0.65, SimplePlanes=True, Tolerance=0})
mesh_3 = MeshBrep(
    Brep=geo,
    Settings={GridMaxCount=0, GridMinCount=16, JaggedSeams=False, MaxEdgeLength=0, MinEdgeLength=0.0001, MinTolerance=0, Refine=True, RefineAngle=0, RelativeTolerance=0.65, SimplePlanes=True, Tolerance=0})
arrbox = BoxArray(Geometry=mesh, Cell=bbox.Box, XCount=X, YCount=1, ZCount=z)  # -> Geometry, Transform
arrbox_2 = BoxArray(Geometry=mesh_3, Cell=bbox.Box, XCount=X, YCount=y, ZCount=1)  # -> Geometry, Transform
arrbox_3 = BoxArray(Geometry=mesh_2, Cell=bbox.Box, XCount=1, YCount=y, ZCount=z)  # -> Geometry, Transform
multiplication_3 = Multiplication(A=X, B=latticepitch)
multiplication_4 = Multiplication(A=z, B=latticepitch)
multiplication_5 = Multiplication(A=y, B=latticepitch)
Y = UnitY(Factor=multiplication_5)
X_2 = UnitX(Factor=multiplication_3)
Z = UnitZ(Factor=multiplication_4)
move = Move(Geometry=arrbox.Geometry, Motion=Y)  # -> Geometry, Transform
move_2 = Move(Geometry=arrbox_3.Geometry, Motion=X_2)  # -> Geometry, Transform
move_3 = Move(Geometry=arrbox_2.Geometry, Motion=Z)  # -> Geometry, Transform

# ----
# Connect these two when you want to array the thing
mesh_4 = MeshBrep(
    Brep=voxelgeometry,
    Settings={GridMaxCount=0, GridMinCount=16, JaggedSeams=False, MaxEdgeLength=0, MinEdgeLength=0.0001, MinTolerance=0, Refine=True, RefineAngle=0, RelativeTolerance=0.65, SimplePlanes=True, Tolerance=0})
arrbox_4 = BoxArray(Geometry=mesh_4, Cell=bbox.Box, XCount=X, YCount=y, ZCount=z)  # -> Geometry, Transform

addition = Addition(A=_1_4_20_clearance_diameter_in_mm, B=extra_width_on_plate_edge_outside_hole)

flatten_2 = FlattenTree(Tree=merge_2, Path="{0}")
join = BrepJoin(Breps=flatten_2)  # -> Breps, Closed
multiplication_6 = Multiplication(A=-1, B=dispatch.ListA)
geo_2 = Geometry(join.Breps)
mesh_5 = MeshBrep(
    Brep=merge_2,
    Settings={GridMaxCount=0, GridMinCount=16, JaggedSeams=False, MaxEdgeLength=0, MinEdgeLength=0.0001, MinTolerance=0, Refine=True, RefineAngle=0, RelativeTolerance=0.65, SimplePlanes=True, Tolerance=0})
Z_2 = UnitZ(Factor=multiplication_6)
multiplication_7 = Multiplication(A=z, B=dispatch.ListA)
multiplication_8 = Multiplication(A=-1, B=dispatch.ListA)
move_4 = Move(Geometry=item_13, Motion=Z_2)  # -> Geometry, Transform
Z_3 = UnitZ(Factor=multiplication_7)
Z_4 = UnitZ(Factor=multiplication_8)
multiplication_9 = Multiplication(A=z, B=dispatch.ListA)
move_5 = Move(Geometry=mesh_5, Motion=Z_4)  # -> Geometry, Transform
move_6 = Move(Geometry=item_14, Motion=Z_3)  # -> Geometry, Transform
mesh_6 = MeshBrep(
    Brep=move_4.Geometry,
    Settings={GridMaxCount=0, GridMinCount=16, JaggedSeams=False, MaxEdgeLength=0, MinEdgeLength=0.0001, MinTolerance=0, Refine=True, RefineAngle=0, RelativeTolerance=0.65, SimplePlanes=True, Tolerance=0})
Z_5 = UnitZ(Factor=multiplication_9)
move_7 = Move(Geometry=geo_2, Motion=Z_5)  # -> Geometry, Transform
mesh_7 = MeshBrep(
    Brep=move_6.Geometry,
    Settings={GridMaxCount=0, GridMinCount=16, JaggedSeams=False, MaxEdgeLength=0, MinEdgeLength=0.0001, MinTolerance=0, Refine=True, RefineAngle=0, RelativeTolerance=0.65, SimplePlanes=True, Tolerance=0})
arrrec = RectangularArray(Geometry=mesh_6, Cell=bbox_2.Box, XCount=X, YCount=y)  # -> Geometry, Transform
arrrec_2 = RectangularArray(Geometry=move_5.Geometry, Cell=bbox_2.Box, XCount=X, YCount=y)  # -> Geometry, Transform
mesh_8 = MeshBrep(
    Brep=move_7.Geometry,
    Settings={GridMaxCount=0, GridMinCount=16, JaggedSeams=False, MaxEdgeLength=0, MinEdgeLength=0.0001, MinTolerance=0, Refine=True, RefineAngle=0, RelativeTolerance=0.65, SimplePlanes=True, Tolerance=0})
arrrec_3 = RectangularArray(Geometry=mesh_7, Cell=bbox_2.Box, XCount=X, YCount=y)  # -> Geometry, Transform
arrrec_4 = RectangularArray(Geometry=mesh_8, Cell=bbox_2.Box, XCount=X, YCount=y)  # -> Geometry, Transform

round = Round()  # -> Nearest, Floor, Ceiling
neg_2 = Negative(Value=plateheight)
Z_6 = UnitZ(Factor=neg_2)
orient_3 = Orient(Geometry=capgeometry, Source=PlaneXY(0, 0, 0), Target=xz_2)  # -> Geometry, Transform
smesh = SimpleMesh()
orient_4 = Orient(Geometry=capgeometry, Source=PlaneXY(0, 0, 0), Target=yz)  # -> Geometry, Transform

split_3 = SplitBrep(Brep=orient_3.Geometry, Cutter=planesrf)
split_4 = SplitBrep(Brep=orient_4.Geometry, Cutter=planesrf)
item_15 = ListItem(List=split_3, Index=1, Wrap=True)
item_16 = ListItem(List=split_3, Index=0, Wrap=True)
item_17 = ListItem(List=split_4, Index=1, Wrap=True)
item_18 = ListItem(List=split_4, Index=0, Wrap=True)
mesh_9 = MeshBrep(
    Brep=item_15,
    Settings={GridMaxCount=0, GridMinCount=16, JaggedSeams=False, MaxEdgeLength=0, MinEdgeLength=0.0001, MinTolerance=0, Refine=True, RefineAngle=0, RelativeTolerance=0.65, SimplePlanes=True, Tolerance=0})
mesh_10 = MeshBrep(
    Brep=item_17,
    Settings={GridMaxCount=0, GridMinCount=16, JaggedSeams=False, MaxEdgeLength=0, MinEdgeLength=0.0001, MinTolerance=0, Refine=True, RefineAngle=0, RelativeTolerance=0.65, SimplePlanes=True, Tolerance=0})
mesh_11 = MeshBrep(
    Brep=item_16,
    Settings={GridMaxCount=0, GridMinCount=16, JaggedSeams=False, MaxEdgeLength=0, MinEdgeLength=0.0001, MinTolerance=0, Refine=True, RefineAngle=0, RelativeTolerance=0.65, SimplePlanes=True, Tolerance=0})
mesh_12 = MeshBrep(
    Brep=item_18,
    Settings={GridMaxCount=0, GridMinCount=16, JaggedSeams=False, MaxEdgeLength=0, MinEdgeLength=0.0001, MinTolerance=0, Refine=True, RefineAngle=0, RelativeTolerance=0.65, SimplePlanes=True, Tolerance=0})
multiplication_10 = Multiplication(A=z, B=dispatch.ListA)
multiplication_11 = Multiplication(A=-1, B=dispatch.ListA)
multiplication_12 = Multiplication(A=z, B=dispatch.ListA)
multiplication_13 = Multiplication(A=-1, B=dispatch.ListA)
Z_7 = UnitZ(Factor=multiplication_10)
Z_8 = UnitZ(Factor=multiplication_11)
Z_9 = UnitZ(Factor=multiplication_12)
Z_10 = UnitZ(Factor=multiplication_13)
move_8 = Move(Geometry=mesh_9, Motion=Z_7)  # -> Geometry, Transform
move_9 = Move(Geometry=mesh_11, Motion=Z_8)  # -> Geometry, Transform
move_10 = Move(Geometry=mesh_10, Motion=Z_9)  # -> Geometry, Transform
move_11 = Move(Geometry=mesh_12, Motion=Z_10)  # -> Geometry, Transform
arrrec_5 = RectangularArray(Geometry=move_8.Geometry, Cell=bbox.Box, XCount=X, YCount=1)  # -> Geometry, Transform
multiplication_14 = Multiplication(A=y, B=dispatch.ListA)
arrrec_6 = RectangularArray(Geometry=move_9.Geometry, Cell=bbox.Box, XCount=X, YCount=1)  # -> Geometry, Transform
multiplication_15 = Multiplication(A=y, B=dispatch.ListA)
arrrec_7 = RectangularArray(Geometry=move_11.Geometry, Cell=bbox.Box, XCount=1, YCount=y)  # -> Geometry, Transform
Y_2 = UnitY(Factor=multiplication_14)
Y_3 = UnitY(Factor=multiplication_15)
arrrec_8 = RectangularArray(Geometry=move_10.Geometry, Cell=bbox.Box, XCount=1, YCount=y)  # -> Geometry, Transform
multiplication_16 = Multiplication(A=X, B=dispatch.ListA)
multiplication_17 = Multiplication(A=X, B=dispatch.ListA)
move_12 = Move(Geometry=arrrec_5.Geometry, Motion=Y_2)  # -> Geometry, Transform
move_13 = Move(Geometry=arrrec_6.Geometry, Motion=Y_3)  # -> Geometry, Transform
X_3 = UnitX(Factor=multiplication_16)
X_4 = UnitX(Factor=multiplication_17)
move_14 = Move(Geometry=arrrec_7.Geometry, Motion=X_3)  # -> Geometry, Transform
move_15 = Move(Geometry=arrrec_8.Geometry, Motion=X_4)  # -> Geometry, Transform

X_5 = UnitX(Factor=25.4)
Y_4 = UnitY(Factor=25.4)
X_6 = UnitX(Factor=25.4)
Y_5 = UnitY(Factor=25.4)
neg_3 = Negative(Value=plateheight)
Z_11 = UnitZ(Factor=neg_3)
neg_4 = Negative(Value=plateheight)
bbox_3 = BoundingBox(Content=arrbox_4.Geometry, Plane=PlaneXY(0, 0, 0), UnionBox=True)  # -> Box, Box_2
Z_12 = UnitZ(Factor=neg_4)
boxprop = BoxProperties(Box=bbox_3.Box)  # -> Center, Diagonal, Area, Volume, Degeneracy
xy = XYPlane(Origin=boxprop.Center)

multiplication_18 = Multiplication(A=y, B=dispatch.ListA)
multiplication_19 = Multiplication(A=X, B=dispatch.ListA)
neg_5 = Negative(Value=0.5)
neg_6 = Negative(Value=0.5)
multiplication_20 = Multiplication(A=neg_5, B=dispatch.ListA)
multiplication_21 = Multiplication(A=neg_6, B=dispatch.ListA)
addition_2 = Addition(A=multiplication_19, B=multiplication_20)
addition_3 = Addition(A=multiplication_18, B=multiplication_21)
pt = ConstructPoint(XCoordinate=0, YCoordinate=0, ZCoordinate=multiplication_21)
pt_2 = ConstructPoint(XCoordinate=multiplication_21, YCoordinate=multiplication_21, ZCoordinate=multiplication_21)
pt_3 = ConstructPoint(XCoordinate=addition_2, YCoordinate=addition_3, ZCoordinate=multiplication_21)
xy_2 = XYPlane(Origin=pt)
incrament = Incrament(A=z)
incrament_2 = Incrament(A=z)
_2x = Double(A=plateheight)
multiplication_22 = Multiplication(A=incrament, B=dispatch.ListA)
multiplication_23 = Multiplication(A=incrament_2, B=dispatch.ListA)
rec_2pt = Rectangle2Pt(Plane=xy_2, PointA=pt_2, PointB=pt_3, Radius=0)  # -> Rectangle, Length
addition_4 = Addition(A=multiplication_22, B=_2x)
addition_5 = Addition(A=multiplication_23, B=plateheight)
neg_7 = Negative(Value=plateheight)
Z_13 = UnitZ(Factor=neg_7)
# Side Surface
extr = Extrude(Base=rec_2pt.Rectangle, Direction=Z_13)
Z_14 = UnitZ(Factor=addition_4)
Z_15 = UnitZ(Factor=addition_5)
move_16 = Move(Geometry=extr, Motion=Z_15)  # -> Geometry, Transform

holepatternselector = DecideHolePattern(S=rec_2pt.Rectangle, A=_1_4_20_clearance_diameter_in_mm)
neg_8 = Negative(Value=holepatternselector)
neg_9 = Negative(Value=holepatternselector)
X_7 = UnitX(Factor=expr("x*0.5", neg_8))
Y_6 = UnitY(Factor=expr("0.5*x", neg_9))
addition_6 = Addition(A=holepatternselector, B=addition)
neg_10 = Negative(Value=holepatternselector)
neg_11 = Negative(Value=holepatternselector)
expression = Expression(PlateW=addition_6, X=X, Y=y, Pitch=latticepitch, Expression="-PlateW*0.5 + X*Pitch/2 - Pitch/2")
expression_2 = Expression(PlateL=addition_6, X=X, Y=y, Pitch=latticepitch, Expression="-PlateL/ 2 + Y*Pitch/2 - Pitch/2")
expression_3 = Expression(PlateW=addition_6, X=X, Y=y, Pitch=latticepitch, Expression="PlateW/ 2 + X*Pitch/2 - Pitch/2")
expression_4 = Expression(PlateL=addition_6, X=X, Y=y, Pitch=latticepitch, Expression="PlateL/ 2 + Y*Pitch/2 - Pitch/2")
expression_5 = Expression(x=holepatternselector, Expression="x/ 25.4")
expression_6 = Expression(x=holepatternselector, Expression="x/ 25.4 + 1")
X_8 = UnitX(Factor=expr("x*0.5", neg_10))
Y_7 = UnitY(Factor=expr("0.5*x", neg_11))

edges = BrepEdges(Brep=extr)  # -> Naked, Interior, NonManifold
item_19 = ListItem(List=edges.Naked, Index=2, Wrap=True)
item_20 = ListItem(List=edges.Naked, Index=0, Wrap=True)
item_21 = ListItem(List=edges.Naked, Index=4, Wrap=True)
item_22 = ListItem(List=edges.Naked, Index=3, Wrap=True)
# Bottom Surface
edgesrf = EdgeSurface(CurveA=item_20, CurveB=item_19, CurveC=item_22, CurveD=item_21)

pcen = PolygonCenter(Polyline=rec_2pt.Rectangle)  # -> CenterV, CenterE, CenterA
pt_4 = Point(pcen.CenterV)
xy_3 = XYPlane(Origin=pt_4)
cyl = Cylinder(Base=xy_3, Radius=expr("x*0.5", _1_4_20_clearance_diameter_in_mm), Length=expr("-x", plateheight))
move_17 = Move(Geometry=cyl, Motion=Y_6)  # -> Geometry, Transform
cir = Circle(Plane=xy_3, Radius=expr("x*0.5", _1_4_20_clearance_diameter_in_mm))
move_18 = Move(Geometry=move_17.Geometry, Motion=X_7)  # -> Geometry, Transform
move_19 = Move(Geometry=cir, Motion=Y_7)  # -> Geometry, Transform
# Bottom
edges_2 = BrepEdges(Brep=move_18.Geometry)  # -> Naked, Interior, NonManifold
move_20 = Move(Geometry=move_19.Geometry, Motion=X_8)  # -> Geometry, Transform
expression_7 = Expression(x=holepatternselector, Expression="x/ 25.4")
expression_8 = Expression(x=holepatternselector, Expression="x/ 25.4 + 1")
item_23 = ListItem(List=edges_2.Naked, Index=0, Wrap=True)
pt_5 = ConstructPoint(XCoordinate=expression, YCoordinate=expression_2, ZCoordinate=multiplication_21)
pt_6 = ConstructPoint(XCoordinate=expression_3, YCoordinate=expression_4, ZCoordinate=multiplication_21)
arrlinear = LinearArray(Geometry=item_23, Direction=X_5, Count=expression_6)  # -> Geometry, Transform
arrlinear_2 = LinearArray(Geometry=item_23, Direction=Y_4, Count=expression_5)  # -> Geometry, Transform

move_21 = Move(Geometry=edgesrf, Motion=Z_14)  # -> Geometry, Transform

arrlinear_3 = LinearArray(Geometry=move_20.Geometry, Direction=X_6, Count=expression_8)  # -> Geometry, Transform
arrlinear_4 = LinearArray(Geometry=move_20.Geometry, Direction=Y_5, Count=expression_7)  # -> Geometry, Transform
rec_2pt_2 = Rectangle2Pt(Plane=xy_2, PointA=pt_5, PointB=pt_6, Radius=0)  # -> Rectangle, Length
cull_i = CullIndex(List=arrlinear_2.Geometry, Indices=0, Wrap=True)
cull_i_2 = CullIndex(List=arrlinear_4.Geometry, Indices=0, Wrap=True)
geo_3 = Geometry(cull_i)
geo_4 = Geometry(cull_i_2)
xz_3 = XZPlane(Origin=pt_4)
yz_2 = YZPlane(Origin=pt_4)
mirror = Mirror(Geometry=arrlinear.Geometry, Plane=xz_3)  # -> Geometry, Transform
xz_4 = XZPlane(Origin=pt_4)
yz_3 = YZPlane(Origin=pt_4)
mirror_2 = Mirror(Geometry=geo_3, Plane=yz_2)  # -> Geometry, Transform
move_22 = Move(Geometry=rec_2pt_2.Rectangle, Motion=Z_11)  # -> Geometry, Transform
mirror_3 = Mirror(Geometry=arrlinear_3.Geometry, Plane=xz_4)  # -> Geometry, Transform
mirror_4 = Mirror(Geometry=geo_4, Plane=yz_3)  # -> Geometry, Transform
merge_3 = Merge(Data1=arrlinear.Geometry, Data2=mirror.Geometry, Data3=geo_3, Data4=mirror_2.Geometry)
flatten_3 = FlattenTree(Tree=merge_3, Path="{0}")
# Bottom Surface
merge_4 = Merge(Data1=move_22.Geometry, Data2=flatten_3)
merge_5 = Merge(Data1=arrlinear_3.Geometry, Data2=mirror_3.Geometry, Data3=geo_4, Data4=mirror_4.Geometry)
merge_6 = Merge(Data1=rec_2pt_2.Rectangle, Data2=merge_5)
boundary = BoundarySurfaces(Edges=merge_4)
flatten_4 = FlattenTree(Tree=merge_5, Path="{0}")
merge_7 = Merge(Data1=rec_2pt.Rectangle, Data2=rec_2pt_2.Rectangle, Data3=flatten_4)
merge_8 = Merge(Data1=merge_6, Data2=rec_2pt_2.Rectangle)
extr_2 = Extrude(Base=merge_6, Direction=Z_6)
boundary_2 = BoundarySurfaces(Edges=merge_7)
move_23 = Move(Geometry=flatten(merge_8), Motion=Z_12)  # -> Geometry, Transform
boundary_3 = BoundarySurfaces(Edges=move_23.Geometry)
merge_9 = Merge(Data1=move_16.Geometry, Data2=move_21.Geometry, Data3=extr, Data4=edgesrf)
merge_10 = Merge(Data1=boundary_2, Data2=flatten(extr_2), Data3=boundary)
dispatch_4 = Dispatch(List=merge_9, DispatchPattern=tensionspecimen)  # -> ListA, ListB
join_2 = BrepJoin(Breps=merge_10)  # -> Breps, Closed
mirror_5 = Mirror(Geometry=join_2.Breps, Plane=xy)  # -> Geometry, Transform
merge_11 = Merge(Data1=mirror_5.Geometry, Data2=join_2.Breps)
dispatch_5 = Dispatch(List=flatten(merge_11), DispatchPattern=tensionspecimen)  # -> ListA, ListB
merge_12 = Merge(Data1=dispatch_4.ListB, Data2=dispatch_5.ListA)
mesh_13 = MeshBrep(
    Brep=join_2.Breps,
    Settings={GridMaxCount=0, GridMinCount=16, JaggedSeams=False, MaxEdgeLength=0, MinEdgeLength=0.0001, MinTolerance=0, Refine=True, RefineAngle=0, RelativeTolerance=0.65, SimplePlanes=True, Tolerance=0})
mesh_14 = MeshBrep(
    Brep=flatten(merge_12),
    Settings={GridMaxCount=0, GridMinCount=16, JaggedSeams=False, MaxEdgeLength=0, MinEdgeLength=0.0001, MinTolerance=0, Refine=True, RefineAngle=0, RelativeTolerance=0.65, SimplePlanes=True, Tolerance=0})
merge_13 = Merge(
    Data1=arrbox_4.Geometry,
    Data2=arrbox.Geometry,
    Data3=move.Geometry,
    Data4=arrbox_3.Geometry,
    Data5=move_2.Geometry,
    Data6=arrbox_2.Geometry,
    Data7=move_3.Geometry,
    Data8=arrrec_6.Geometry,
    Data9=move_13.Geometry,
    Data10=arrrec_5.Geometry,
    Data11=move_12.Geometry,
    Data12=arrrec_7.Geometry,
    Data13=move_14.Geometry,
    Data14=arrrec_8.Geometry,
    Data15=move_15.Geometry,
    Data16=arrrec_4.Geometry,
    Data17=arrrec.Geometry,
    Data22=arrrec_3.Geometry,
    Data23=arrrec_2.Geometry,
    Data24=mesh_14)
R = ClusterOutput(merge_13)

# ==== cluster MinimumCuboct
pitch = ClusterInput()
strutwidth = ClusterInput()
num = Number(strutwidth)
angle = Number(0.7853981634)

csc = CoSecant(Value=angle)
# Convert pitch to strut length (of frame)
multiplication = Multiplication(A=pitch, B=0.5)
multiplication_2 = Multiplication(A=multiplication, B=csc)

sin = Sine(Value=angle)
cos = Cosine(Value=angle)
_2 = Number(2)
cos_2 = Cosine(Value=angle)
division = Division(A=num, B=_2)
division_2 = Division(A=sin, B=cos)
neg = Negative(Value=division)
multiplication_3 = Multiplication(A=cos_2, B=num)
multiplication_4 = Multiplication(A=num, B=sin)
multiplication_5 = Multiplication(A=division, B=division_2)
addition = Addition(A=multiplication_3, B=division)
addition_2 = Addition(A=multiplication_4, B=multiplication_5)
neg_2 = Negative(Value=addition)

midnodept = ConstructPoint(XCoordinate=expr("x/sqrt(2)", multiplication_2), YCoordinate=0, ZCoordinate=expr("x/sqrt(2)", multiplication_2))
topnode = ConstructPoint(XCoordinate=0, YCoordinate=0, ZCoordinate=expr("2*x/sqrt(2)", multiplication_2))
cubevector = VectorXYZ(XComponent=expr("-x", 1), YComponent=expr("x", 1), ZComponent=0)  # -> Vector, Length
panel = Panel("Frame Geometry")
ln = Line(StartPoint=midnodept, EndPoint=topnode)
line = LineSDL(Start=midnodept, Direction=cubevector.Vector, Length=multiplication_2)
ln_2 = Line(StartPoint=Point(0, 0, 0), EndPoint=midnodept)
arrpolar = PolarArray(Geometry=midnodept, Plane=PlaneXY(0, 0, 0), Count=4, Angle=6.283185307)  # -> Geometry, Transform
arrpolar_2 = PolarArray(Geometry=line, Plane=PlaneXY(0, 0, 0), Count=4, Angle=6.283185307)  # -> Geometry, Transform
arrpolar_3 = PolarArray(Geometry=ln, Plane=PlaneXY(0, 0, 0), Count=4, Angle=6.283185307)  # -> Geometry, Transform
arrpolar_4 = PolarArray(Geometry=ln_2, Plane=PlaneXY(0, 0, 0), Count=4, Angle=6.283185307)  # -> Geometry, Transform
item = ListItem(List=arrpolar.Geometry, Index=1, Wrap=True)
item_2 = ListItem(List=arrpolar.Geometry, Index=2, Wrap=True)
item_3 = ListItem(List=arrpolar.Geometry, Index=3, Wrap=True)
item_4 = ListItem(List=arrpolar.Geometry, Index=0, Wrap=True)
merge = Merge(Data1=arrpolar_4.Geometry, Data2=arrpolar_3.Geometry, Data3=arrpolar_2.Geometry)

sqrt = SquareRoot(Value=2)
multiplication_6 = Multiplication(A=multiplication_2, B=2)
midnodept_2 = ConstructPoint(XCoordinate=expr("x/sqrt(2)", multiplication_2), YCoordinate=expr("x/sqrt(2)", multiplication_2), ZCoordinate=0)
midnodept_3 = ConstructPoint(XCoordinate=expr("-x/sqrt(2)", multiplication_2), YCoordinate=expr("-x/sqrt(2)", multiplication_2), ZCoordinate=0)
division_3 = Division(A=multiplication_6, B=sqrt)
rec_2pt = Rectangle2Pt(Plane=PlaneXY(0, 0, 0), PointA=midnodept_2, PointB=midnodept_3, Radius=0)  # -> Rectangle, Length
boxrec = BoxRectangle(Rectangle=rec_2pt.Rectangle, Height=division_3)

pt = ConstructPoint(XCoordinate=division, YCoordinate=neg, ZCoordinate=addition_2)
pt_2 = ConstructPoint(XCoordinate=neg, YCoordinate=neg, ZCoordinate=addition_2)
pt_3 = ConstructPoint(XCoordinate=neg, YCoordinate=division, ZCoordinate=addition_2)
pt_4 = ConstructPoint(XCoordinate=division, YCoordinate=division, ZCoordinate=addition_2)

pt_5 = ConstructPoint(XCoordinate=addition, YCoordinate=division, ZCoordinate=0)
pt_6 = ConstructPoint(XCoordinate=addition, YCoordinate=neg, ZCoordinate=0)
pt_7 = ConstructPoint(XCoordinate=neg, YCoordinate=neg_2, ZCoordinate=0)
pt_8 = ConstructPoint(XCoordinate=neg_2, YCoordinate=neg, ZCoordinate=0)
pt_9 = ConstructPoint(XCoordinate=division, YCoordinate=neg_2, ZCoordinate=0)
pt_10 = ConstructPoint(XCoordinate=division, YCoordinate=addition, ZCoordinate=0)
pt_11 = ConstructPoint(XCoordinate=neg, YCoordinate=addition, ZCoordinate=0)
pt_12 = ConstructPoint(XCoordinate=neg_2, YCoordinate=division, ZCoordinate=0)

pt_13 = ConstructPoint(XCoordinate=addition, YCoordinate=division, ZCoordinate=multiplication_5)
pt_14 = ConstructPoint(XCoordinate=addition, YCoordinate=neg, ZCoordinate=multiplication_5)
pt_15 = ConstructPoint(XCoordinate=neg, YCoordinate=neg_2, ZCoordinate=multiplication_5)
pt_16 = ConstructPoint(XCoordinate=neg_2, YCoordinate=neg, ZCoordinate=multiplication_5)
pt_17 = ConstructPoint(XCoordinate=division, YCoordinate=neg_2, ZCoordinate=multiplication_5)
pt_18 = ConstructPoint(XCoordinate=neg, YCoordinate=addition, ZCoordinate=multiplication_5)
pt_19 = ConstructPoint(XCoordinate=neg_2, YCoordinate=division, ZCoordinate=multiplication_5)
pt_20 = ConstructPoint(XCoordinate=division, YCoordinate=addition, ZCoordinate=multiplication_5)

srf4pt = _4PointSurface(CornerA=pt_20, CornerB=pt_18, CornerC=pt_11, CornerD=pt_10)
srf4pt_2 = _4PointSurface(CornerA=pt_19, CornerB=pt_16, CornerC=pt_8, CornerD=pt_12)
srf4pt_3 = _4PointSurface(CornerA=pt_15, CornerB=pt_17, CornerC=pt_9, CornerD=pt_7)
srf4pt_4 = _4PointSurface(CornerA=pt_14, CornerB=pt_13, CornerC=pt_5, CornerD=pt_6)

srf4pt_5 = _4PointSurface(CornerA=pt, CornerB=pt_17, CornerC=pt_14)
srf4pt_6 = _4PointSurface(CornerA=pt_2, CornerB=pt_16, CornerC=pt_15)
srf4pt_7 = _4PointSurface(CornerA=pt_3, CornerB=pt_18, CornerC=pt_19)
srf4pt_8 = _4PointSurface(CornerA=pt_4, CornerB=pt_13, CornerC=pt_20)

srf4pt_9 = _4PointSurface(CornerA=pt_20, CornerB=pt_10, CornerC=pt_5, CornerD=pt_13)
srf4pt_10 = _4PointSurface(CornerA=pt_18, CornerB=pt_11, CornerC=pt_12, CornerD=pt_19)
srf4pt_11 = _4PointSurface(CornerA=pt_16, CornerB=pt_15, CornerC=pt_7, CornerD=pt_8)
srf4pt_12 = _4PointSurface(CornerA=pt_17, CornerB=pt_14, CornerC=pt_6, CornerD=pt_9)

srf4pt_13 = _4PointSurface(CornerA=pt_4, CornerB=pt_3, CornerC=pt_2, CornerD=pt)
merge_2 = Merge(Data1=srf4pt_8, Data2=srf4pt_7, Data3=srf4pt_6, Data4=srf4pt_5)
merge_3 = Merge(Data1=srf4pt_9, Data2=srf4pt_10, Data3=srf4pt_11, Data4=srf4pt_12)
merge_4 = Merge(Data1=srf4pt, Data2=srf4pt_2, Data3=srf4pt_3, Data4=srf4pt_4)
merge_5 = Merge(Data1=pt_4, Data2=pt, Data3=pt_13, Data4=pt_14)

mid_strut_nodept = ConstructPoint(XCoordinate=expr("0.5*x/sqrt(2)", multiplication_2), YCoordinate=0, ZCoordinate=expr("0.5*x/sqrt(2)", multiplication_2))
plfit = PlaneFit(Points=merge_5)  # -> Plane, Deviation
pt_21 = PointOriented(BasePlane=plfit.Plane, UComponent=0, VComponent=0, WComponent=0)
bottom_strut_vector = Vector2Pt(PointA=pt_21, PointB=mid_strut_nodept, Unitize=False)  # -> Vector, Length
geo = Geometry(merge_5)
move = Move(Geometry=geo, Motion=bottom_strut_vector.Vector)  # -> Geometry, Transform

merge_6 = Merge(Data1=merge_2, Data2=merge_3, Data3=merge_4, Data4=srf4pt_13)
flatten = FlattenTree(Tree=merge_6, Path="{0}")
join = BrepJoin(Breps=flatten)  # -> Breps, Closed
xz = XZPlane(Origin=item)
plfit_2 = PlaneFit(Points=arrpolar.Geometry)  # -> Plane, Deviation
geo_2 = Geometry(join.Breps)
minimumnodegeometry = ClusterOutput(geo_2)

item_5 = ListItem(List=merge_5, Index=1, Wrap=True)
item_6 = ListItem(List=merge_5, Index=0, Wrap=True)
item_7 = ListItem(List=merge_5, Index=2, Wrap=True)
item_8 = ListItem(List=merge_5, Index=3, Wrap=True)
item_9 = ListItem(List=move.Geometry, Index=2, Wrap=True)
item_10 = ListItem(List=move.Geometry, Index=1, Wrap=True)
item_11 = ListItem(List=move.Geometry, Index=0, Wrap=True)
item_12 = ListItem(List=move.Geometry, Index=3, Wrap=True)
srf4pt_14 = _4PointSurface(CornerA=item_5, CornerB=item_10, CornerC=item_12, CornerD=item_8)
srf4pt_15 = _4PointSurface(CornerA=item_5, CornerB=item_6, CornerC=item_11, CornerD=item_10)
srf4pt_16 = _4PointSurface(CornerA=item_6, CornerB=item_11, CornerC=item_9, CornerD=item_7)
srf4pt_17 = _4PointSurface(CornerA=item_7, CornerB=item_9, CornerC=item_12, CornerD=item_8)
merge_7 = Merge(Data1=srf4pt_14, Data2=srf4pt_15, Data3=srf4pt_16, Data4=srf4pt_17)

fmerge = MergeFaces(Brep=merge_7)  # -> Breps, Before, After

arrpolar_5 = PolarArray(Geometry=fmerge.Breps, Plane=PlaneXY(0, 0, 0), Count=4, Angle=6.283185307)  # -> Geometry, Transform

merge_8 = Merge(Data1=merge_6, Data2=arrpolar_5.Geometry)
orient = Orient(Geometry=merge_8, Source=PlaneXY(0, 0, 0), Target=xz)  # -> Geometry, Transform
arrpolar_6 = PolarArray(Geometry=orient.Geometry, Plane=PlaneXY(0, 0, 0), Count=4, Angle=6.283185307)  # -> Geometry, Transform
mirror = Mirror(Geometry=merge_8, Plane=plfit_2.Plane)  # -> Geometry, Transform
merge_9 = Merge(Data1=merge_8, Data2=mirror.Geometry, Data3=arrpolar_6.Geometry)
flatten_2 = FlattenTree(Tree=merge_9, Path="{0}")
join_2 = BrepJoin(Breps=flatten_2)  # -> Breps, Closed

bbox = BoundingBox(Content=join_2.Breps, Plane=PlaneXY(0, 0, 0))  # -> Box, Box_2
# Calculate the Relative Density
cap = CapHoles(Brep=join_2.Breps)
volume = Volume(Geometry=bbox.Box)  # -> Volume, Centroid
volume_2 = Volume(Geometry=cap)  # -> Volume, Centroid
division_4 = Division(A=volume_2.Volume, B=volume.Volume)

panel_2 = Panel(division_4)
minimumvoxel = ClusterOutput(join_2.Breps)

# ==== cluster Halve
A = ClusterInput()
division = Division(A=A, B=2)
R = ClusterOutput(division)

# ==== cluster OctogonSurface
A = ClusterInput()
B = ClusterInput()
B_2 = ClusterInput()
B_3 = ClusterInput()
B_4 = ClusterInput()
B_5 = ClusterInput()
B_6 = ClusterInput()
B_7 = ClusterInput()
ln = Line(StartPoint=A, EndPoint=B)
ln_2 = Line(StartPoint=B, EndPoint=B_2)
ln_3 = Line(StartPoint=B_2, EndPoint=B_4)
ln_4 = Line(StartPoint=B_4, EndPoint=B_3)
ln_5 = Line(StartPoint=B_3, EndPoint=B_5)
ln_6 = Line(StartPoint=B_5, EndPoint=B_6)
ln_7 = Line(StartPoint=B_6, EndPoint=B_7)
ln_8 = Line(StartPoint=B_7, EndPoint=A)
merge = Merge(Data1=ln, Data2=ln_2, Data3=ln_3, Data4=ln_4, Data5=ln_5, Data6=ln_6, Data7=ln_7, Data8=ln_8)
join = JoinCurves(Curves=merge, Preserve=False)
boundary = BoundarySurfaces(Edges=join)
S = ClusterOutput(boundary)

# ==== cluster Incrament
A = ClusterInput()
addition = Addition(A=A, B=1)
R = ClusterOutput(addition)

# ==== cluster Double
A = ClusterInput()
num = Number(2)
multiplication = Multiplication(A=A, B=num)
R = ClusterOutput(multiplication)

# ==== cluster DecideHolePattern
S = ClusterInput()
# Take max dimension of lattice (of xy)
dim = Dimensions(Surface=S)  # -> UDimension, VDimension
A = ClusterInput()
int = Integer(4)
max = Maximum(A=dim.UDimension, B=dim.VDimension)
addition = Addition(A=A, B=int)
num = Number(76.2)
num_2 = Number(25.4)
num_3 = Number(127)
num_4 = Number(177.8)
subtraction = Subtraction(A=num_2, B=addition)
subtraction_2 = Subtraction(A=num, B=addition)
subtraction_3 = Subtraction(A=num_3, B=addition)
subtraction_4 = Subtraction(A=num_4, B=addition)
smaller = SmallerThan(FirstNumber=max, SecondNumber=subtraction_2)  # -> SmallerThan, OrEqualTo
smaller_2 = SmallerThan(FirstNumber=max, SecondNumber=subtraction)  # -> SmallerThan, OrEqualTo
smaller_3 = SmallerThan(FirstNumber=max, SecondNumber=subtraction_3)  # -> SmallerThan, OrEqualTo
smaller_4 = SmallerThan(FirstNumber=max, SecondNumber=subtraction_4)  # -> SmallerThan, OrEqualTo
dispatch = Dispatch(List=num_4, DispatchPattern=smaller_4.SmallerThan)  # -> ListA, ListB
dispatch_2 = Dispatch(List=num_3, DispatchPattern=smaller_3.SmallerThan)  # -> ListA, ListB
dispatch_3 = Dispatch(List=num_2, DispatchPattern=smaller_2.SmallerThan)  # -> ListA, ListB
dispatch_4 = Dispatch(List=num, DispatchPattern=smaller.SmallerThan)  # -> ListA, ListB
merge = Merge(Data1=dispatch_3.ListA, Data2=dispatch_4.ListA, Data3=dispatch_2.ListA, Data4=dispatch.ListA)
sort = SortList(Keys=merge)  # -> Keys, ValuesA
item = ListItem(List=sort.Keys, Index=0, Wrap=True)
i = ClusterOutput(item)
